% Simulink data dictionary pidSMC.sldd

T_sample_control = 0.001
Ts = 0.001
PID_pitch = struct(Kp_in=0.07093954, Kd_in=2.048811, Kp_out=0.4711031, Kd_out=0.7386247, Ki_out=2.04649)
PID_roll = struct(Kp_in=0.9739884, Kd_in=1.65386, Kp_out=0.6821175, Kd_out=0.7467598, Ki_out=0.2803504)
PID_thr = struct(Kp_out=35.00155, Kd_out=6.362854, Ki_out=226.3338)
PID_yaw = struct(Kp_out=2.51976, Kd_out=1.227402, Ki_out=177.4581)